# Grasshopper definition TestFile.gh (Grasshopper 1.0.4)
# plug-ins: CurvedCreaseFolding, Weaverbird

number_slider = Slider(3, range=0..3)  # disabled
c_script = CSharpScript()  # -> out, A; inputs M: Mesh; disabled
# ---------- c_script: C# ----------
    var mesh = M;
    var naked = mesh.GetNakedEdgePointStatus();

    var lines = new List<Line>();

    for (int i = 20; i < M.TopologyVertices.Count; i++)
    {
      int index = mesh.TopologyVertices.MeshVertexIndices(i).First();
      if (naked[index]) continue;

      var adjacencies = mesh.TopologyVertices.ConnectedTopologyVertices(i, true);

      foreach(var adjacent in adjacencies)
        lines.Add(new Line(M.TopologyVertices[i], M.TopologyVertices[adjacent]));


      break;
    }

    A = lines;
# ---------- end c_script ----------
rectangle = Rectangle(Plane=PlaneXY(0, 0, 0), XSize="0 to 10", YSize="0 to 10", Radius=0)  # -> Rectangle, Length
number_slider_2 = Slider(10, range=0..10)
item = ListItem(List=c_script.A, Index=number_slider, Wrap=True)  # disabled
wbtriangles = WeaverbirdsSplitTrianglesSubdivision(Level=Slider(4, range=0..4))
msphere = MeshSphere(Base=PlaneXY(0, 0, 0), Radius=10, UCount=10, VCount=20)

# ---- group: Flat mesh
mplane = MeshPlane(Boundary=rectangle.Rectangle, WidthCount=number_slider_2, HeightCount=number_slider_2)  # -> Mesh, Area
crv_1 = Curve(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)
crv_2 = Curve(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)

# ---- group: Flat Mesh
mesh = Mesh(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)
crv = Curve([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])

# ---- group: 3D mesh
mesh_2 = Mesh(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)

# ----
crv_3 = Curve(flatten([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]))
mesh_3 = Mesh(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)
mesh_4 = Mesh(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)

mesh_5 = Mesh(mplane.Mesh)
crv_4 = Curve(crv)
crvcrsfld = CurvedCreaseFolding(Mesh=mesh_5, Angle=Slider(1.27, range=0..2), FoldCurves=crv_1)  # -> Mesh, Mesh2D
mesh_6 = Mesh(crvcrsfld.Mesh)
mesh_7 = Mesh(crvcrsfld.Mesh2D)
bbox = BoundingBox(Content=mesh_6, Plane=PlaneXY(0, 0, 0))  # -> Box, Box_2
material = CreateMaterial(
    Diffuse=ColourSwatch(SwatchColor=RGB(0, 255, 234)),
    Specular=RGB(255, 255, 255),
    Emission=ColourSwatch(SwatchColor=RGB(0, 0, 0)),
    Transparency=Slider(0, range=0..1),
    Shine=Slider(0, range=0..100))
pipe = Pipe(Curve=crv_4, Radius=Slider(0.05, range=0..0.1), Caps=0)
debox = DeconstructBox(Box=bbox.Box)  # -> Plane, X, Y, Z
X = UnitX(Factor=debox.X)
multiplication = Multiplication(A=X, B=Slider(1.5, range=0..10))

medges = MeshEdges(Mesh=mesh_6)  # -> NakedEdges, InteriorEdges, NonManifoldEdges
move = Move(Geometry=mesh_7, Motion=multiplication)  # -> Geometry, Transform
preview = CustomPreview(Geometry=mesh_6, Material=material)
preview_2 = CustomPreview(Geometry=pipe, Material=ColourSwatch(SwatchColor=RGBA(0, 0, 255, 100)))
